# Requirement set ACC (R2022a)

## 1 [LeadVehicle_SwReq_01]
Lead Vehicle is a vehicle which is driving in the road ahead of our drive vehicle. Two input signals (Signal Name: CameraInput_LeadVehicle & RadarInput_LeadVehicle).
Ideally sensor fusion techniques will be deployed to process & analyze data from camera & radar. For complexity reasons, let’s not adapt to any such algorithms.
We can simply add both the radar & camera inputs & the corresponding output is read as Speed profile output (Signal Name: LeadVehicle_Speed).
Speed data of the lead vehicle is critical in implementing the Adaptive Cruise Control algorithm.

## 2 [DriveVehicle_SwRqe_02]
Drive Vehicle is the vehicle driven by the user & this is the vehicle which has ACC algorithm in it.
Like the Lead Vehicle, Drive Vehicle algorithm also has 2 input signals (Signal Name: CameraInput_DriveVehicle, RadarInput_DriveVehicle) & one signal coming as an Input to this subsystem (Signal Name: Acceleration_Mode) – three inputs into this requirement in total.
Like the above requirement, sensor fusion techniques will also be deployed here, for complexity reasons we are ignoring them.
Two output signals come from this subsystem (Signal Name: DriveVehicle_Speed & LeadVehicle_Detected).
Signal DriveVehicle_Speed is summation of three input signals mentioned above & LeadVehicle_Detected is renamed from Input Signal RadarInput_DriveVehicle by mere use of Signal Conversion block.

## 3 [ACC_Control_Algorithm_SwReq_03]
Adaptive Cruise Control feature has 3 major modes of operation: OFF Mode, STANDBY Mode & ON Mode. This particular requirement has to be implemented as state machine logic in Simulink.
The input signals to this state machine system are (Signal Name: Time_Gap, Set_Speed, Set_Gap, CruiseSwitch, SetSwitch).
Also, the output signals (Signal Name: DriveVehicle_Speed & LeadVehicle_Detected) from requirement-2 is fed back as an input signal into this state machine block.
Additionally, output signal (Signal Name: LeadVehicle_Speed) from requirement-1 is given as an input signal to this state machine block as well.
Output from this subsystem is a signal (Signal Name: Acceleration_Mode) which governs the vehicular speed of the drive vehicle which automatically adjusts its speed & velocity to match the lead vehicle.

### 3.1 [ACC Off Mode state logic_03_01]
This is the default state inside state machine logic. Output signal Acceleration_Mode is at value 0 in this state.
This state is governed by input signal CruiseSwitch.
If CruiseSwitch is equal to 1, state ACC STANDBY mode will get activated. If CruiseSwitch is equal to 0, state ACC OFF mode will get activated, from either ACC ON mode or ACC STANDBY mode.

#### 3.1.1 [ACC Standby Mode state logic_03_02]
This is the second activated state inside state machine logic. Output signal Acceleration_Mode is at value 1 in this state.
This state is governed by both input signals CruiseSwitch & SetSwitch.
If CruiseSwitch is equal to 1, state ACC STANDBY mode will get activated. If CruiseSwitch is equal to 0, state ACC OFF mode will get activated, from either ACC ON mode or ACC STANDBY mode
If SetSwitch is equal to 1, state ACC ON mode will get activated. If SetSwitch is equal to 0, state ACC STANDBY mode will get activated.